# Grasshopper definition DeciGen_TOPSIS_Example.gh (Grasshopper 1.0.7)
# plug-ins: DeciGenArch

surface_area = Panel("""1000
1200
1100
1150""")
number_of_surfaces = Panel("""25
15
14
35""")
tonnage = Panel("""500
300
450
333""")
number_of_joints = Panel("""600
549
457
345""")
tonnage_2 = Slider(0.7, range=0..1)
number_of_surfaces_2 = Slider(0.5, range=0..1)
number_of_joints_2 = Slider(0.3, range=0..1)
surface_area_2 = Slider(0.4, range=0..1)
merge = Merge(Data1=graft(tonnage), Data2=graft(number_of_surfaces), Data3=graft(number_of_joints), Data4=graft(surface_area))
design_options = Panel("""Roof option 1 
Roof option 2
Roof option 3
Roof option 4""")
objectives_min_0_max_1 = Panel("""0
0
1
0""")
criteria = Panel("""Tonnage
Number of Surfaces
Number of Joints
Surface Area""")
weights_for_dm = Merge(Data1=tonnage_2, Data2=number_of_surfaces_2, Data3=number_of_joints_2, Data4=surface_area_2)
topsis = TOPSIS(
    DesignOptions=design_options,
    InputMatrix=merge,
    Criteria=criteria,
    Objectives=objectives_min_0_max_1,
    Weights=weights_for_dm)  # -> Rankings, Ideal, AntiIdeal, Performance
panel = Panel(topsis.Rankings)
panel_2 = Panel(topsis.Performance)
panel_3 = Panel(topsis.Ideal)
panel_4 = Panel(topsis.AntiIdeal)
